% Simulink data dictionary flightPhasedata2.sldd

flightPhaseEnum = enum(DefaultValue="Parked")
  Parked = 0
  Taxi = 1
  TakeOff = 2
  Cruise = 3
  Landing = 4

cruiseVelocity = Simulink.Parameter(300, DataType="double", Unit="km/h")
cruiseTime = Simulink.Parameter(20, DataType="double", Unit="sec")
landingAltitude = Simulink.Parameter(1000, DataType="double", Unit="m")
takeoffAltitude = Simulink.Parameter(10, DataType="double", Unit="m")