test file "parabus6"

suite "New Test Suite 1"

  case "New Test Case 1" [baseline]
    model Misil_Simulink_bus, harness Misil_Simulink_bus_Harness1 (for Misil_Simulink_bus/Aerodinamicaa)
    input "Hoja1" from entradasaerodinamicagrandeparabus.xlsx, mapped to u -> In1_velocidades_u, v -> In1_velocidades_v, w -> In1_velocidades_w, p -> In1_velocidades_p, q -> In1_velocidades_q, r -> In1_velocidades_r, x -> In1_pos_angulos_x, y -> In1_pos_angulos_y, z -> In1_pos_angulos_z, phi -> In1_pos_angulos_phi, tetha -> In1_pos_angulos_tetha, psi -> In1_pos_angulos_psi, ro -> In1_densidad, delta_e -> In1_control_delta_e, delta_r -> In1_control_delta_r, delta_a -> In1_control_delta_a, thrust -> In1_control_thrust
    input "datos.mat", mapped to u, v, w, p, q, r, x, y, z, phi, tetha, psi, ro, delta_e, delta_r, delta_a, thrust (active)
    pre-load callback:
      codigos
    baseline "Hoja1": abs tol 5, rel tol 0.1
      Fx: abs tol 30, rel tol 0.1
      Fy
      Fz: abs tol 30, rel tol 0.1
      L
      M
      N