test file "testaerodinamica"

suite "New Test Suite 1"

  case "New Test Case 1" [baseline]
    model Aerodinamicaa, harness Misil_Simulink_Harness1
    input "entradaaerodinamica.mat", mapped to In1
    input "input" from entradasaerodinamicagrande.xlsx, mapped to In1 (active)
    pre-load callback:
      codigos
    baseline "baseline1": rel tol 0.05
      Out1:1: rel tol 0.05, leading tol 0.4, lagging tol 0.4
    baseline "baseline1 (1)" (0 of 2 signals compared)
    baseline "Hoja1" (0 of 6 signals compared)
    baseline "Hoja1 (1)" (0 of 6 signals compared)
    baseline "baseline1 (2)": rel tol 0.05
      Aerodinamicaa:1
      Out1:1